# Grasshopper definition Environmental Analysis with Grasshopper - Solar Radiation.gh (Grasshopper 1.0.7)
# plug-ins: Bifocals

ladybug = Ladybug_Ladybug()  # -> Vviiiiiiiiiizzz; plug-in component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

# ----
# 2
panel = Panel("F:\AEC\Research\CIT\Stage_2\Course\Environmental_Analysis_with_GH")
panel_2 = Panel("F:\AEC\Research\CIT\Stage_2\Course\DEU_TH_Weimar.105550_TMYx\DEU_TH_Weimar.105550_TMYx.epw")
toggle = BooleanToggle(True)
gencumulativeskymtx = Ladybug_GenCumulativeSkyMtx(epwFile=panel_2, skyDensity=Slider(1, range=0..1), workingDir=panel, useOldRes=toggle, runIt=toggle)  # -> readMe, cumulativeSkyMtx; plug-in component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
selectskymtx = Ladybug_selectSkyMtx(cumulativeSkyMtx=gencumulativeskymtx.cumulativeSkyMtx, removeDiffuse=False, removeDirect=False)  # -> readMe, selectedSkyMtx; plug-in component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

panel_3 = Panel("F:\AEC\Research\CIT\Stage_2\Course\DEU_TH_Weimar.105550_TMYx\DEU_TH_Weimar.105550_TMYx.stat")
importstat = Ladybug_ImportStat(statFile=panel_3)  # -> readMe, ashraeClimateZone, koppenClimateZone, heatingDesignTemps, coolingDesignTemps, heatingDesignDay, coolingDesignDay, monthlyTauBeam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; plug-in component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
selectskymtx_2 = Ladybug_selectSkyMtx(
    cumulativeSkyMtx=gencumulativeskymtx.cumulativeSkyMtx,
    analysisPeriod=importstat.typicalWinterWeek,
    removeDiffuse=False,
    removeDirect=False)  # -> readMe, selectedSkyMtx; plug-in component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

honeybee = Honeybee_Honeybee()  # -> Vviiiiiiiiiizzz; plug-in component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
butterfly = Butterfly()  # -> swooooosh; "BF::BF"; plug-in component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

gradientlibrary = Ladybug_GradientLibrary(gradIndex=Slider(1, range=0..10))  # -> customColors; plug-in component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
legendpar = Ladybug_LegendParameters(
    lowBound="0",
    highBound="2000",
    customColors=flatten(gradientlibrary),
    font="Arial",
    decimalPlaces="1",
    removeLessThan=Toggle(True))  # -> legendPar; plug-in component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

# ----
# 3
number_slider = Slider(1, range=0..10)
gradientlibrary_2 = Ladybug_GradientLibrary(gradIndex=number_slider)  # -> customColors; plug-in component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
legendpar_2 = Ladybug_LegendParameters(
    lowBound="0",
    highBound="100",
    customColors=flatten(gradientlibrary_2),
    font="Arial",
    decimalPlaces="1",
    removeLessThan=Toggle(True))  # -> legendPar; plug-in component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

# ---- group: Yearly - Solar Radiation
# 1
number_slider_2 = Slider(0.1, range=0..0.1)
toggle_2 = BooleanToggle(True)
analysisarea = Surface(<surface referenced from the Rhino model>)
buildings = Brep([<brep referenced from the Rhino model> x71])
radiationanalysis = Ladybug_RadiationAnalysis(
    geometry=flatten(analysisarea),
    context=flatten(buildings),
    gridSize=Slider(2, range=0..10),
    disFromBase=number_slider_2,
    selectedSkyMtx=flatten(selectskymtx.selectedSkyMtx),
    parallel=toggle_2,
    runIt=toggle_2)  # -> readMe, contextMesh, analysisMesh, testPts, testVec, port, radiationResult, radiationMesh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; plug-in component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

# ---- group: Typical Spring Week - SR
toggle_3 = BooleanToggle(True)
analysisarea_2 = Surface(<surface referenced from the Rhino model>)
buildings_2 = Brep([<brep referenced from the Rhino model> x71])
radiationanalysis_2 = Ladybug_RadiationAnalysis(
    geometry=flatten(analysisarea_2),
    context=flatten(buildings_2),
    gridSize=Slider(2, range=0..10),
    disFromBase=Slider(0.1, range=0..0.1),
    selectedSkyMtx=flatten(selectskymtx_2.selectedSkyMtx),
    parallel=toggle_3,
    runIt=toggle_3)  # -> readMe, contextMesh, analysisMesh, testPts, testVec, port, radiationResult, radiationMesh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; plug-in component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

# ---- group: % of total yearly radiation
# 4
panel_4 = Panel("1250")
division = Division(A=radiationanalysis.radiationResult, B=panel_4)
multiplication = Multiplication(A=division, B="100")
recolormesh = Ladybug_RecolorMesh(
    analysisResult=multiplication,
    inputMesh=radiationanalysis.radiationMesh,
    legendPar=legendpar_2,
    analysisTitle="Percentage of total yearly radiation",
    legendTitle="%")  # -> readMe, newMesh, newLegend, legendBasePt, meshColors, legendColors; plug-in component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

# ---- group: average spring-day equivalent solar radiation
panel_5 = Panel("Average spring-day equivalent radiation throughout the year")
division_2 = Division(A=radiationanalysis.radiationResult, B="4.5")

# ----
multiplication_2 = Multiplication(A=division_2, B="7")

# ---- group: average spring-day equivalent solar radiation (continued)
recolormesh_2 = Ladybug_RecolorMesh(
    analysisResult=multiplication_2,
    inputMesh=radiationanalysis.radiationMesh,
    legendPar=legendpar,
    analysisTitle=panel_5,
    legendTitle="# days")  # -> readMe, newMesh, newLegend, legendBasePt, meshColors, legendColors; plug-in component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
