# Grasshopper definition PedSimFlowScript.gh (Grasshopper 1.0.7)
# plug-ins: PedSimulation

# ----
# End Point(s)
pt = Point([<point referenced from the Rhino model> x42])

# ----
# Start Point(s)
pt_2 = Point([<point referenced from the Rhino model> x3])

# ----
# Visit Point(s)
pt_3 = Point(<point referenced from the Rhino model>)

pill_tag = BooleanToggle(False)
pill_tag_2 = BooleanToggle(False)
gate = Gate(
    Position=pt_2,
    GateName="Start",
    ExitTime=Slider(0, range=0..1),
    AccessRadius=Slider(1, range=0..1),
    DrawDot=pill_tag,
    Color=ColourSwatch(SwatchColor=RGB(71, 71, 71)))
gate_2 = Gate(
    Position=pt,
    GateName="Door",
    ExitTime=Slider(0, range=0..1),
    AccessRadius=Slider(1, range=0..1),
    DrawDot=pill_tag_2,
    Color=ColourSwatch(SwatchColor=RGB(71, 71, 71)))
program = ProgramComponent(ProgramName="Ignore", DisplayColor=ColourSwatch(SwatchColor=RGB(97, 97, 97)))
body_width = Slider(0.55, range=0.3..0.95)
# Visit points are needed
# for the simulation to run,
# however in my case, I
# choose to ignore it.
pill_tag_3 = BooleanToggle(False)
crossref = CrossReference(ListA=gate, ListB=gate_2, CrossMode=1)  # -> ListA, ListB
target = Target(
    Position=pt_3,
    Program=program,
    VisitingTime=Slider(10, range=0..500),
    AccessRadius=1,
    DrawDot=pill_tag_3,
    createMultipleTargets=True)

# ----
# Obstacle Curves
spawn_time = Slider(100, range=1..100, expression="x/4")
crv = Curve([<curve referenced from the Rhino model> x42])

fanvision = FanShapedVision(Angle=Slider(150, range=0..1000), Distance=Slider(5, range=0..100))
pt_4 = PersonTemplate(
    StartGate=crossref.ListA,
    DestinationGate=crossref.ListB,
    Interests=program,
    NeedValue=Slider(1, range=0..10),
    StartNumber=0,
    Probability=Slider(1, range=0..10),
    TimeLimit=-1,
    Vision=fanvision,
    BodyRadius=expr("x/2", body_width),
    TargetForce=20,
    DisplayColor=ColourSwatch(SwatchColor=RGB(97, 97, 97)),
    PersonTemplateDirectionMode=1)

# ----
# Reset Simulation
button = Button()

merge = Merge(Data1=target)

# ----
# Trigger
timer = Timer(Interval=10, TimerInterval=10, Target=pedsim)

pedsim = PedSimulationSystem(
    Reset=button,
    PersonTemplates=pt_4,
    ObstacleCurves=crv,
    Population=Slider(10, range=1..10, expression="x*100"),
    Targets=merge,
    GenerationTime=spawn_time)  # -> Out, People, GraphEdges, GraphVertices, GoalTagPositions, VisitCounts, PersonRecords
deconsp = DeconstructPerson(Person=pedsim.People)  # -> ID, TemplateID, Position, BodyRadius, Velocity, Acceleration, CurrentPath, Behaviors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

# ----
# Preview Sightline
drawperson = DrawPerson(People=pedsim.People, drawCurrentTargetFill=True, drawFOV=True, drawNumber=True)

lng = ListLength(List=pedsim.People)

# ----
# Preview Points/Paths
pt_5 = Point(deconsp.Position)
crv_2 = Curve(deconsp.CurrentPath)

# ----
# Population In-Game
panel = Panel(lng)
